# Grasshopper definition wall.ghx (Grasshopper 1.0.7)
# plug-ins: Karamba3D

reload = Button()
py = PythonScript(reload=reload)
# ---------- py: Python ----------
from compas_rhino.utilities.misc import get_tolerance
from compas_rhino.utilities.misc import unload_modules

from compas_ghpython import unload_modules

unload_modules("compas")
unload_modules("compas_fab")
unload_modules("roslibpy")
unload_modules("fabrication_control")
unload_modules("assembly_information_model")
unload_modules("am_information_model")
unload_modules("ur_fabrication_control")
unload_modules("workshop_aaec_revamp")
unload_modules("add_on_am")
# ---------- end py ----------
py_2 = PythonScript()  # -> HERE, DATA
# ---------- py_2: Python ----------
import os

HERE = os.path.dirname(ghdoc.Path)
DATA = os.path.abspath(os.path.join(HERE, "..", "data"))

#print(HERE)
print(DATA)
# ---------- end py_2 ----------

# ---- group: DESIGN / Shape Initialization
number_slider = Slider(0, range=0..360)
number_slider_2 = Slider(2, range=0..10)
number_slider_3 = Slider(0, range=0..10)
number_slider_4 = Slider(4, range=0..10)
number_slider_5 = Slider(0.05, range=0..0.1)
number_slider_6 = Slider(0, range=0..10)
toggle = BooleanToggle(False)

# ---- group: DESIGN
create_wall = GhPythonScript(
    init=Button(),
    width=number_slider_4,
    height=number_slider_2,
    elsize=number_slider_5,
    x=number_slider_6,
    y=number_slider_3,
    rotation=number_slider,
    double_layer=toggle)  # -> wall
# ---------- create_wall: Python ----------
from add_on_am import Wall

import random
# create wall
wall = Wall(width, height, elsize, x, y, rotation)

print(wall.x_size, wall.z_size)
# ---------- end create_wall ----------

# ----
python = GhPythonScript()  # -> out, a
# ---------- python: Python ----------
print(x(a))
# ---------- end python ----------
create_window = GhPythonScript(
    wall=create_wall,
    left=Slider(0.8, range=0..10),
    right=Slider(3, range=0..10),
    top=Slider(1.8, range=0..5),
    bottom=Slider(0.6, range=0..5))  # -> out, wall
# ---------- create_window: Python ----------
if left < right < wall.width and bottom < top < wall.height:
    wall.window((left, top), (right, bottom))
# ---------- end create_window ----------

# ---- group: UNDULATION
undulate = GhPythonScript(
    wall=create_window.wall,
    up_amp=Slider(0.03, range=0..0.1),
    up_freq=Slider(3, range=0..10),
    up_phase=Slider(0, range=0..6.2),
    down_amp=Slider(0.2, range=0..1),
    down_freq=Slider(0.5, range=0..10),
    down_phase=Slider(0, range=0..6.2))  # -> wall
# ---------- undulate: Python ----------
wall.undulate(up_amp, up_freq, up_phase ,down_amp, down_freq, down_phase)
# ---------- end undulate ----------

# ---- group: VISUALIZATION
visualize = GhPythonScript(wall=undulate, show_mesh=Toggle(True), show_window=Toggle(True), delete_window=Toggle(True))  # -> out, rhmesh, vertices_window, vertices_support
# ---------- visualize: Python ----------
from compas_ghpython.artists import MeshArtist
import Rhino.Geometry as rg

rh_mesh = []
vertices_gate = []
vertices_all = []
disp_vectors = []

if delete_window:
    for vertex in wall.window_vertices:
        wall.mesh.delete_vertex(vertex)
        print("test")



if show_mesh:
    # Mesh Artist for visualization
    artist = MeshArtist(wall.mesh)
    rhmesh = artist.draw_mesh()


if show_window:
    k = []
    for vertex in wall.mesh.vertices():
        gp = wall.mesh.vertex_attribute(vertex, name='window')
        if gp: k.append(vertex)
    
    print k
    if len(k): vertices_window = artist.draw_vertices(vertices=k)

for vertex in wall.mesh.vertices():
    if wall.mesh.vertex_attribute(vertex, name='z') < 0.025:
        k.append(vertex)
if len(k): vertices_support = artist.draw_vertices(vertices=k)
# ---------- end visualize ----------
mesh = Mesh(visualize.rhmesh)
preview = CustomPreview(Geometry=mesh, Material=ColourSwatch(SwatchColor=RGB(255, 0, 0)))

# ----
cross_section = CrossSectionKaramba3D(
    FamilyNameOfCrossSection="DefaultCroSec",
    Height_cm=Slider(10, range=0..10),
    ReinforcementAreas_cm2_m=[0, 0, 0, 0],
    ReinforcementConcreteCovers_cm=[3.5, 4.5, -4.5, -3.5],
    PrincipalReinforcementDirection_deg=0,
    mode="Shell RC Standard - Const.")
meshtoshell = MeshToShellKaramba3D(Mesh=visualize.rhmesh, Identifier="Mesh", CrossSection=cross_section, LimitDistance_m=0.005)  # -> Element, Points, Info
pt = Point(visualize.vertices_support)
supp = SupportKaramba3D(PosInd=pt, menu=[buttons(on, on, on, off, off, off)])
pt_2 = Point(visualize.vertices_window)
loads = LoadsKaramba3D(Vector=Vector(0, 0, -1), LCase="0", mode="Gravity")
assemble = AssembleModelKaramba3D(Elem=meshtoshell.Element, Support=supp, Load=loads, LimitDistance_m=0.005)  # -> Model, Info, Mass_kg, CenterOfGravity, LoadCaseNames
panel = Panel(assemble.Model)
analyze = AnalyzeKaramba3D(Model=assemble.Model)  # -> CalculatedModel, MaximumDisplacement_cm, ResultingForceOfGravity_kN, ElasticEnergyChange_kNm
modelview = ModelViewKaramba3D(Model=analyze.CalculatedModel, ResultFactors=Slider(100, range=0..100), ResultCase=-1)  # -> Model, DeformedMesh, DeformedAxes, DeformedModel
mesh_2 = Mesh(modelview.DeformedMesh)
s_forces = ShellForcesKaramba3D(AnalyzedModel=analyze.CalculatedModel, mode="Local")  # -> AnalyzedModel, Nxx_kN_m, Nyy_kN_m, Nxy_kN_m, Mxx_kNm_m, Myy_kNm_m, Mxy_kNm_m, Vx_kN_m, Vy_kN_m
shellview = ShellViewKaramba3D(Model=modelview.Model, IndexOfLayer=0)  # -> Model, MeshesOfRenderedShells, LegendColors, LegendTags
list = ValueList({"N1": 0, "N2": 1}, selected="N2")
disassemble = DisassembleModelKaramba3D(Model=s_forces.AnalyzedModel)  # -> Model, Point, Beam, Shell, Support, Load, Line, Mesh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
python_2 = GhPythonScript(n1=s_forces.Nxx_kN_m, n2=s_forces.Nyy_kN_m, select=list)  # -> norm_n, red, green, blue; inputs n1: list, n2: list
# ---------- python_2: Python ----------
if select:
    n = n1
elif not select:
    n = n2

max_n = max(n) # 1
min_n = min(n) # -1
# n=0
norm_n = []
red = []
green = [0 for _ in n]
blue = []
for force in n:
    if force >= 0:
        norm_force = 255*force/max_n
        red.append(255)
        blue.append(0)
    elif force < 0:
        norm_force = 255*force/min_n
        red.append(0)
        blue.append(255)
    norm_n.append(norm_force)
print(len(red), len(blue), len(green))
# ---------- end python_2 ----------
mesh_3 = Mesh(shellview.MeshesOfRenderedShells)
demesh = DeconstructMesh(Mesh=mesh_3)  # -> Vertices, Faces, Colours, Normals
rgb = ColourRGB(Alpha=Slider(255, range=0..1000), Red=python_2.red, Green=python_2.green, Blue=python_2.blue)
demesh_2 = DeconstructMesh(Mesh=disassemble.Mesh)  # -> Vertices, graft(Faces), Colours, Normals
panel_2 = Panel(demesh.Colours)
python_3 = GhPythonScript(colors=demesh.Colours)  # -> red, green, blue; inputs colors: list
# ---------- python_3: Python ----------
red = []
green = [0 for _ in colors]
blue = []
for color in colors:
    if color[0] == 255:
        red.append(0)
        blue.append(255)
    elif color[2] == 255:
        red.append(255)
        blue.append(0)
    else:
        print(error)
        red.append(255)
        blue.append(255)
# ---------- end python_3 ----------
conmesh = ConstructMesh(Vertices=demesh_2.Vertices, Faces=demesh_2.Faces)
rgb_2 = ColourRGB(Alpha=Slider(255, range=0..1000), Red=python_3.red, Green=python_3.green, Blue=python_3.blue)
mcol = MeshColours(Mesh=conmesh, Colours=graft(rgb))
mcol_2 = MeshColours(Mesh=mesh_3, Colours=rgb_2)
